# Grasshopper definition ABxM CrossSectionAgents Karamba3d.gh (Grasshopper 1.0.7)
# plug-ins: HygroDesign, ABxM.Grasshopper, Karamba3D, LunchBox, sof_gh_sofistik-2022

io = IO(
    SofistikDocumentProperties_VersionMajor="2022",
    SofistikDocumentProperties_VersionMinor="0",
    SofistikDocumentProperties_VersionName="2022")
agent_perception = Slider(2, range=0..10)
agent_count = Slider(5, range=0..10)
num = Number(agent_count)
num_2 = Number(agent_perception)

# ---- group: initial positions
distance_between_agents = Slider(0.5, range=0..1)
num_3 = Number(num)
dup = DuplicateData(Data=Slider(-0.1, range=-1..1), Number=expr("x-2", num_3), Order=True)
num_4 = Number(distance_between_agents)
merge = Merge(Data1=flatten("0"), Data2=flatten(dup), Data3=flatten("0"))
series = Series(Start=0, Step=num_4, Count=num_3)
pt = ConstructPoint(XCoordinate=series, YCoordinate=0, ZCoordinate=merge)
pt_2 = Point(pt)

# ---- group: training behavior
num_5 = Number(num_2)
dqltraining = DQLTrainingBehaviour(Perception=num_5)
data = Data(dqltraining)

# ---- group: edge agents
pt_3 = Point(pt_2)
data_2 = Data(data)
c_script = CSharpScript(Reference=["C:\USERS\ALEX REINER\DESKTOP\HygroDesign\ABxM.Core.dll", "C:\Users\Alex Reiner\AppData\Roaming\Grasshopper\Libraries\HygroDesign\HygroDesign.Core.dll"])  # -> out, oBehaviour
# ---------- c_script: C# usings ----------
using ABxM.Core;
using ABxM.Core.Agent;
using ABxM.Core.Behavior;

using HygroDesign.Core;
# ---------- c_script: C# ----------
    oBehaviour = endBehaviour;
# ---------- c_script: C# additional code ----------
  EndBehaviour endBehaviour = new EndBehaviour();

  public class EndBehaviour : BehaviorBase
  {
    public EndBehaviour()
    {
    }

    public override void Execute(AgentBase agent)
    {
      //initialization
      CrossSectionAgent CSAgent = agent as CrossSectionAgent;

      CSAgent.Moves.Clear();
      CSAgent.Weights.Clear();

      return;
    }
  }
# ---------- end c_script ----------
item = ListItem(List=reverse(pt_3), Index=0, Wrap=True)
item_2 = ListItem(List=pt_3, Index=0, Wrap=True)
merge_2 = Merge(Data1=item_2, Data2=item)
merge_3 = Merge(Data1=data_2, Data2=c_script.oBehaviour)
agent = CrossSectionAgent(StartingPoint=merge_2, Behaviours=merge_3)  # -> flatten(CrossSectionAgent)
data_3 = Data(agent)

# ---- group: training agents
pt_4 = Point(pt_2)
data_4 = Data(data)
lng = ListLength(List=pt_2)  # -> expr("x-2", Length)
dom = ConstructDomain(DomainStart=1, DomainEnd=lng)
subset = SubList(List=pt_4, Domain=dom, Wrap=True)  # -> List, Index
agent_2 = CrossSectionAgent(StartingPoint=subset.List, Behaviours=data_4)  # -> flatten(CrossSectionAgent)
data_5 = Data(agent_2)

# ---- group: generate cross section
pt_5 = Point(pt_2)
board_width = Slider(0.15, range=0.1..0.5)
nurbs = NurbsCurve(Vertices=pt_5, Degree=3, Periodic=False)  # -> reparameterize(Curve), Length, Domain
geo = Geometry(nurbs.Curve)
crosec = CrossSectionFromNurbsCurve(NurbsCurve=geo, BoardWidth=board_width)
data_6 = Data(crosec)

# ---- group: recreate agent list
data_7 = Data(data_5)
data_8 = Data(data_3)
item_3 = ListItem(List=data_8, Index=0, Wrap=True)  # -> Item, Item1
merge_4 = Merge(Data1=flatten(item_3.Item), Data2=flatten(data_7), Data3=flatten(item_3.Item1))

# ---- group: create agent system
data_9 = Data(merge_4)
data_10 = Data(data_6)
agentsystem = CrossSectionAgentSystem(CrossSection=data_10, Agents=data_9, DisplacementThreshold=-1, SoftResetValue=Slider(20, range=0..20))
data_11 = Data(agentsystem)

# ---- group: solver
data_12 = Data(data_11)
trigger = Trigger(Interval=20, TimerInterval=20, Target=solver)  # disabled
solver = StepByStepSolver(Reset=Button(), Execute=Toggle(False), AgentSystems=data_12)  # -> DisplayGeometries, AllAgentSystems, IterationCount
data_13 = Data(solver.AllAgentSystems)
panel = Panel(solver.IterationCount)

# ---- group: deconstruct agent system
data_14 = Data(data_13)
python = GhPythonScript(AgentSystem=data_14)  # -> out, CrossSection, Agents, Points
# ---------- python: Python ----------
CrossSection = AgentSystem.CrossSection
Agents = AgentSystem.Agents

points = []
for agent in AgentSystem.Agents:
    points.append(agent.Position)

Points = points
# ---------- end python ----------
data_15 = Data(python.CrossSection)
pt_6 = Point(python.Points)
data_16 = Data(python.Agents)

# ---- group: deconstruct cross section
data_17 = Data(data_15)
python_2 = GhPythonScript(CrossSection=data_17)  # -> out, AverageRadii, BoardCurves, ControlPointMap
# ---------- python_2: Python ----------
boardCurves = CrossSection.BoardCurves
averageRadii = []
boards = []
ids = []
for board in boardCurves:
    averageRadii.append(board.AverageRadius)
    boards.append(board.Curve)
    ids.append(board.ControlPointID)

AverageRadii = averageRadii
BoardCurves = boards
ControlPointMap = ids
# ---------- end python_2 ----------
num_6 = Number(python_2.ControlPointMap)
crv = Curve(python_2.BoardCurves)
num_7 = Number(python_2.AverageRadii)

# ---- group: curvature rewards per board
minimum_radius_m = Slider(0.5, range=0..1)
num_8 = Number(num_7)
smaller = SmallerThan(FirstNumber=num_8, SecondNumber=minimum_radius_m)  # -> simplify(graft(SmallerThan)), OrEqualTo
not = GateNot(A=smaller.SmallerThan)
cull = CullPattern(List="-10", CullPattern=smaller.SmallerThan)
cull_2 = CullPattern(List="0", CullPattern=not)
merge_5 = Merge(Data1=cull, Data2=cull_2)  # -> flatten(Result)
num_9 = Number(merge_5)

# ---- group: extrude curve
number_slider = Slider(10, range=0..10)
crv_2 = Curve(crv)
Y = UnitY(Factor=number_slider)
extr = Extrude(Base=crv_2, Direction=Y)
midpt = CurveMiddle(Curve=crv_2)
division = Division(A=number_slider, B=2)
num_10 = Number(number_slider)
srf = Surface(extr)
num_11 = Number(division)
pt_7 = Point(midpt)

# ---- group: generage mesh
srf_2 = Surface(srf)
tria = TriangularPanelsA(Surface=srf_2, UDivisions=Slider(53, range=0..100), VDivisions=Slider(1, range=0..100))  # -> simplify(Panels)
smesh = SimpleMesh(Brep=tria)
mjoin = MeshJoin(Meshes=smesh)  # -> flatten(Mesh)
mesh = Mesh(mjoin)

# ---- group: curvature rewards / agent
num_12 = Number(num_6)
num_13 = Number(num_9)
c_script_2 = CSharpScript(item=num_13, map=num_12)  # -> out, A; inputs item: list, map: list of Int32
# ---------- c_script_2: C# ----------
    DataTree<Object> output = new DataTree<Object>();
    for(int i = 0; i < item.Count; i++)
    {
      GH_Path pth = new GH_Path(map[i]);
      output.Add(item[i], pth);
    }
    A = output;
# ---------- end c_script_2 ----------
ma = MassAddition(Input=c_script_2.A)  # -> Result, PartialResults
merge_6 = Merge(Data1="0", Data2=flatten(ma.Result), Data3="0")
num_14 = Number(merge_6)

# ---- group: active layer
e0 = Slider(13449, range=0..100000)
e90 = Slider(764, range=0..100000)
ft0 = Slider(80, range=0..100)
gamma = Slider(6.91, range=0..10)
num_15 = Number(Slider(20, range=0..100))

# ---- group: passive layer
ft0_2 = Slider(0, range=0..100)
num_16 = Number(Slider(4, range=0..10))
e0_2 = Slider(464, range=0..100000)
e90_2 = Slider(10800, range=0..100000)
gamma_2 = Slider(4.58, range=0..10)

# ---- group: active layer / total thickness
addition = Addition(A=num_15, B=num_16)

# ---- group: join mesh segments by agent affiliation
num_17 = Number(num_6)
mesh_2 = Mesh(mesh)
c_script_3 = CSharpScript(item=mesh_2, map=num_17)  # -> out, A; inputs item: list of Mesh, map: list of Int32
# ---------- c_script_3: C# ----------
    DataTree<Mesh> output = new DataTree<Mesh>();
    for(int i = 0; i < item.Count; i++)
    {
      GH_Path pth = new GH_Path(map[i]);
      output.Add(item[i], pth);
    }
    A = output;
# ---------- end c_script_3 ----------
mjoin_2 = MeshJoin(Meshes=c_script_3.A)  # -> flatten(Mesh)
mesh_3 = Mesh(mjoin_2)

# ---- group: active layer / distance from bottom
expression = Expression(x=addition, y=num_15, Expression="x - y/2")

# ---- group: passive layer / distance from bottom
expression_2 = Expression(x=expression, y=addition, Expression="x - y/2")

# ---- group: active layer / CG from bottom
division_2 = Division(A=addition, B=2)

# ---- group: passive layer / dist from CG
subtraction = Subtraction(A=expression_2, B=division_2)
abs = Absolute(Value=subtraction)

# ---- group: active layer / dist from CG
subtraction_2 = Subtraction(A=expression, B=division_2)
abs_2 = Absolute(Value=subtraction_2)

# ---- group: get supports
mesh_4 = Mesh(mesh_3)
num_18 = Number(num_10)
medges = MeshEdges(Mesh=mesh_4)  # -> NakedEdges, InteriorEdges, NonManifoldEdges
crv_3 = Curve(medges.NakedEdges)
explode = Explode(Curve=crv_3, Recursive=True)  # -> Segments, flatten(Vertices)
cullpt = CullDuplicates(Points=explode.Vertices, Tolerance=0.01, CullMode=3)  # -> graft(Points), Indices, Valence
merge_7 = Merge(Data1="0", Data2=num_18)
pdecon = Deconstruct(Point=cullpt.Points)  # -> XComponent, YComponent, ZComponent
equals = Equality(FirstNumber=pdecon.YComponent, SecondNumber=merge_7)  # -> Equality, Inequality
cset = CreateSet(List=equals.Equality)  # -> simplify(Set), Map
lng_2 = ListLength(List=cset.Set)
larger = LargerThan(FirstNumber=lng_2, SecondNumber=1)  # -> LargerThan, OrEqualTo
cull_3 = CullPattern(List=cullpt.Points, CullPattern=larger.LargerThan)  # -> flatten(List)
avr = Average(Input=cull_3)
pdecon_2 = Deconstruct(Point=cull_3)  # -> XComponent, YComponent, ZComponent
pdecon_3 = Deconstruct(Point=avr)  # -> XComponent, YComponent, ZComponent
larger_2 = LargerThan(FirstNumber=pdecon_2.YComponent, SecondNumber=pdecon_3.YComponent)  # -> LargerThan, OrEqualTo
dispatch = Dispatch(List=cull_3, DispatchPattern=larger_2.LargerThan)  # -> ListA, ListB
pt_8 = Point(dispatch.ListB)
pt_9 = Point(dispatch.ListA)

# ---- group: active layer / l
expression_3 = Expression(x=num_15, Expression="1000*x^3/12")

# ---- group: passive layer / l
expression_4 = Expression(x=num_16, Expression="1000*x^3/12")

# ---- group: passive layer / Ax2
expression_5 = Expression(x=num_16, y=abs, Expression="1000*x*y^2")

# ---- group: active layer / Ax2
expression_6 = Expression(x=num_15, y=abs_2, Expression="1000*x*y^2")

# ---- group: active layer / total l
addition_2 = Addition(A=expression_3, B=expression_6)

# ---- group: passive layer / total l
addition_3 = Addition(A=expression_4, B=expression_5)

# ---- group: active layer / El0
multiplication = Multiplication(A=e0, B=addition_2)

# ---- group: active layer / T x ft0
multiplication_2 = Multiplication(A=num_15, B=ft0)

# ---- group: active layer / T x Gam
multiplication_3 = Multiplication(A=gamma, B=num_15)

# ---- group: passive layer / El0
multiplication_4 = Multiplication(A=e0_2, B=addition_3)

# ---- group: passive layer / El90
multiplication_5 = Multiplication(A=e90_2, B=addition_3)

# ---- group: passive layer / T x ft0
multiplication_6 = Multiplication(A=num_16, B=ft0_2)

# ---- group: active layer / El90
multiplication_7 = Multiplication(A=e90, B=addition_2)

# ---- group: effective material properties / El0 eff (Nmm2)
addition_4 = Addition(A=multiplication, B=multiplication_4)

# ---- group: effective material properties / El90 eff (Nmm2)
addition_5 = Addition(A=multiplication_7, B=multiplication_5)

# ---- group: effective material properties / Sum T x Ft0
addition_6 = Addition(A=multiplication_2, B=multiplication_6)

# ---- group: effective material properties / total thickness
addition_7 = Addition(A=num_15, B=num_16)

# ---- group: effective material properties / Sum Tx Gam
addition_8 = Addition(A=multiplication_3)

# ---- group: effective material properties / lx / ly
expression_7 = Expression(x=addition_7, Expression="1000*x^3/12")

# ---- group: effective material properties / E0eff
division_3 = Division(A=addition_4, B=expression_7)

# ---- group: effective material properties / E90eff
division_4 = Division(A=addition_5, B=expression_7)

# ---- group: effective material properties / Gamma eff
division_5 = Division(A=addition_8, B=addition_7)

# ---- group: effective material properties / ft eff
division_6 = Division(A=addition_6, B=addition_7)

# ---- group: effective material properties
matprops = MaterialPropertiesKaramba3D(
    FamilyOfMaterial="CLT",
    Name="CLT",
    ElementIdentifier="CLT",
    YoungsModulusKNCm2Dir1=expr("x*0.1", division_3),
    YoungsModulusKNCm2Dir2=expr("x*0.1", division_4),
    InPlaneShearModulus_kN_cm2="42",
    InPlaneLateralContractionCoefficient=Slider(0.012, range=0..0.1, expression="0.012"),
    TransverseShearModulusKNCm2Dir1="5",
    TransverseShearModulusKNCm2Dir2="5",
    SpecificWeight_kN_m3=division_5,
    CoefficientOfThermalExpansion1CDir1=1.2e-05,
    CoefficientOfThermalExpansion1CDir2=1.2e-05,
    TensileStrengthKNCm2Dir1=division_6,
    TensileStrengthKNCm2Dir2=division_6,
    CompressiveStrengthKNCm2Dir1=-23.5,
    CompressiveStrengthKNCm2Dir2=-23.5,
    ShearStrengthKNCm2Dir12=13.6,
    TsaiWuIntCoeff=0,
    StrengthHypothesis="MISES",
    mode="Orthotropic")  # -> flatten(Material)
num_19 = Number(flatten(addition_7))

# ---- group: Karamba simulation
num_20 = Number(num_19)
mesh_5 = Mesh(mesh_3)
supp = SupportKaramba3D(PosInd=pt_8, menu=[buttons(on, off, on, off, off, off)])
supp_2 = SupportKaramba3D(PosInd=pt_9, menu=[buttons(on, off, on, off, off, off)])
cross_section = CrossSectionKaramba3D(FamilyNameOfCrossSection="DefaultCroSec", Height_cm=expr("x/10", num_20), mode="Shell - Const")
loads = LoadsKaramba3D(Vector=Vector(0, 0, -1), LCase="0", mode="Gravity")
meshtoshell = MeshToShellKaramba3D(Mesh=mesh_5, CrossSection=cross_section, LimitDistance_m=0.005)  # -> Element, Points, Info
assemble = AssembleModelKaramba3D(
    Elem=meshtoshell.Element,
    Support=[supp, supp_2],
    Load=loads,
    CrossSection=cross_section,
    Material=matprops,
    LimitDistance_m=0.005)  # -> Model, Info, Mass_kg, CenterOfGravity, LoadCaseNames
analyze = AnalyzeKaramba3D(Model=assemble.Model)  # -> CalculatedModel, MaximumDisplacement_cm, ResultingForceOfGravity_kN, ElasticEnergyChange_kNm
modelview = ModelViewKaramba3D(Model=analyze.CalculatedModel, ResultFactors=1, ResultCase=-1)  # -> Model, DeformedMesh, DeformedAxes, DeformedModel
shellview = ShellViewKaramba3D(Model=modelview.Model, IndexOfLayer=0)  # -> Model, MeshesOfRenderedShells, LegendColors, LegendTags
mesh_6 = Mesh(shellview.MeshesOfRenderedShells)

# ---- group: ensure mesh position
mesh_7 = Mesh(mesh_6)
bbox = BoundingBox(Content=mesh_7, Plane=PlaneXY(0, 0, 0))  # -> Box, Box_2
debox = DeconstructBox(Box=bbox.Box)  # -> Plane, X, Y, Z
dedomain = DeconstructDomain(Domain=debox.Y)  # -> Start, End
neg = Negative(Value=dedomain.Start)
Y_2 = UnitY(Factor=neg)
move = Move(Geometry=mesh_7, Motion=Y_2)  # -> Geometry, Transform
mesh_8 = Mesh(move.Geometry)

# ---- group: calculate displacements
mesh_9 = Mesh(mesh_8)
pt_10 = Point(pt_7)
num_21 = Number(num_11)
pt_11 = ConstructPoint(XCoordinate=0, YCoordinate=num_21, ZCoordinate=0)
xz = XZPlane(Origin=pt_11)
project = Project(Geometry=pt_10, Plane=xz)  # -> Geometry, Transform
sec = MeshPlane(Mesh=mesh_9, Plane=xz)
crv_cp = CurveClosestPoint(Point=project.Geometry, Curve=sec)  # -> Point, Parameter, Distance

# ----
num_22 = Number(crv_cp.Distance)

# ---- group: remap rewards to agents and add neighbor reward perception
num_23 = Number(num_22)
num_24 = Number(num_6)
c_script_4 = CSharpScript(item=num_23, map=num_24)  # -> out, A; inputs item: list, map: list of Int32; same code as c_script_2
avr_2 = Average(Input=c_script_4.A)  # -> flatten(ArithmeticMean)
neg_2 = Negative(Value=avr_2)
python_3 = GhPythonScript(rewards=neg_2, blur=Slider(2, range=0..10))  # -> out, a; inputs rewards: list, blur: Int32
# ---------- python_3: Python ----------
blurredRewards = []

for i,reward in enumerate(rewards):
    blurValue = 0.0
    divisor = 0
    for j in range(1,blur+1):
        factor = 1/(j*2)
        if i >= j:
            blurValue += rewards[i-j] * factor
            divisor+=1
        if i + j < len(rewards):
            blurValue += rewards[i+j] * factor
            divisor+=1
    blurValue /= divisor
    blurredRewards.append( reward + blurValue)

a = blurredRewards
# ---------- end python_3 ----------
multiplication_8 = Multiplication(A=python_3.a, B=Slider(100, range=0..100))
num_25 = Number(multiplication_8)

# ---- group: reward agents
data_18 = Data(data_16)
num_26 = Number(num_25)
num_27 = Number(num_14)
merge_8 = Merge(Data1="0", Data2=flatten(num_26), Data3="0")  # -> flatten(Result)
addition_9 = Addition(A=merge_8, B=num_27)
train = TrainCrossSectionAgents(Agents=data_18, Reward=addition_9)
