# Grasshopper definition BilayerDesign - Rebuild.gh (Grasshopper 1.0.7)
# plug-ins: HygroDesign

# ---- group: spruce
panel = Panel("spruce")
number_slider = Slider(0.0001, range=0..0.0001)
number_slider_2 = Slider(0.0019, range=0..1)
number_slider_3 = Slider(0.0036, range=0..1)
number_slider_4 = Slider(10000, range=0..20000)
number_slider_5 = Slider(800, range=0..20000)
number_slider_6 = Slider(450, range=0..20000)
number_slider_7 = Slider(400, range=0..1000)

# ---- group: beech
panel_2 = Panel("beech")
number_slider_8 = Slider(0.0001, range=0..0.0001)
number_slider_9 = Slider(0.002, range=0..1)
number_slider_10 = Slider(0.0041, range=0..1)
number_slider_11 = Slider(14000, range=0..20000)
number_slider_12 = Slider(2280, range=0..20000)
number_slider_13 = Slider(1160, range=0..20000)
number_slider_14 = Slider(720, range=0..1000)

# ----
species = WoodSpecies(
    name=panel_2,
    density=number_slider_14,
    LExp=number_slider_8,
    RExp=number_slider_9,
    TExp=number_slider_10,
    LEmod=number_slider_11,
    REmod=number_slider_12,
    TEmod=number_slider_13)
species_2 = WoodSpecies(
    name=panel,
    density=number_slider_7,
    LExp=number_slider,
    RExp=number_slider_2,
    TExp=number_slider_3,
    LEmod=number_slider_4,
    REmod=number_slider_5,
    TEmod=number_slider_6)
panel_3 = Panel(
    HMaxelLength=Slider(250, range=0..1000),
    HMaxelWidth=Slider(150, range=0..1000),
    LengthCount=Slider(20, range=0..100),
    WidthCount=Slider(13, range=0..100))

dec_pan = DeconstructPanel(Panel=panel_3)  # -> Bilayers, HMaxels
dec_hmaxel = DeconstructHMaxel(HMaxel=dec_pan.HMaxels)  # -> PassiveLayers, ActiveBoards, Height, RowRange, ColumnRange
rectangle = Rectangle(Plane=PlaneXY(0, 0, 0), XSize=dec_hmaxel.RowRange, YSize=dec_hmaxel.ColumnRange, Radius=0)  # -> Rectangle, Length
area = Area(Geometry=rectangle.Rectangle)  # -> Area, Centroid
pdecon = Deconstruct(Point=area.Centroid)  # -> XComponent, YComponent, ZComponent
bnd = Bounds(Numbers=pdecon.XComponent)
dom = ConstructDomain(DomainStart=Slider(60, range=0..100), DomainEnd=Slider(24, range=0..100))
remap = RemapNumbers(Value=pdecon.XComponent, Source=bnd, Target=dom)  # -> Mapped, Clipped
up_hmaxel = UpdateHMaxel(HMaxel=dec_pan.HMaxels, Height=remap.Mapped)

data = Data(panel_3)
data_2 = Data(species_2)

data_3 = Data(data)
panel_4 = Panel("""0
1""")
data_4 = Data(data_2)
bilayer = ConstructBilayer(
    Panel=data_3,
    BoardLength=Slider(4, range=0..10),
    RowOffsets=panel_4,
    PassiveSpecies=data_4,
    ActiveThickness=Slider(20, range=0..100),
    PassiveThickness=Slider(4, range=0..10))

data_5 = Data(data)
panel_5 = Panel("""2
3""")
data_6 = Data(data_2)
bilayer_2 = ConstructBilayer(
    Panel=data_5,
    BoardLength=Slider(4, range=0..10),
    RowOffsets=panel_5,
    PassiveSpecies=data_6,
    ActiveThickness=Slider(20, range=0..100),
    PassiveThickness=Slider(4, range=0..10))

merge = Merge(Data1=bilayer, Data2=bilayer_2)
up_pan = UpdatePanel(Panel=panel_3, Bilayers=merge, HMaxels=up_hmaxel)
dec_pan_2 = DeconstructPanel(Panel=up_pan)  # -> Bilayers, HMaxels
python = GhPythonScript(x=dec_pan_2.HMaxels)  # -> out, a
# ---------- python: Python ----------
a = x.Height
# ---------- end python ----------
dec_bilayer = DeconstructBilayer(Bilayer=dec_pan_2.Bilayers)  # -> ActiveLayer, PassiveLayer
dec_passive = DeconstructPassiveLayer(PassiveLayer=dec_bilayer.PassiveLayer)  # -> Species, Thickness
dec_active_board = DeconstructActiveBoard()  # -> HMaxels, StockBoard, DesiredRadius
