# Grasshopper definition Object Oriented Bilayers.gh (Grasshopper 1.0.7)
# plug-ins: sof_gh_sofistik-2022, HygroDesign, MeshEdit Components, Karamba3D, Kangaroo2 Components, Weaverbird, Pufferfish, Human, LunchBox, Opossum2_0_Proto_A

io = IO(
    SofistikDocumentProperties_VersionMajor="2022",
    SofistikDocumentProperties_VersionMinor="0",
    SofistikDocumentProperties_VersionName="2022")
update = Button()
python = GhPythonScript(update=update)  # inputs update: Boolean
# ---------- python: Python ----------
# Seghier Mohamed Abdelaziz - 2021 - seghierdesign@gmail.com

import Grasshopper as gh

ghDoc = ghenv.Component.OnPingDocument()
objects = ghDoc.Objects

object = []

for obj in objects: 

    if obj.NickName.Length == 0:
        if str(obj.RemovedFromDocument.DeclaringType) == "Grasshopper.Kernel.GH_Component":
            object.append(obj)
                
if update == True:
    gh.Kernel.GH_Document.NewSolution(ghDoc,False)
    for o in object:
        gh.Kernel.GH_Document.RemoveObject(ghDoc ,o,False)
# ---------- end python ----------

number_slider = Slider(1000, range=0..1000)
number_slider_2 = Slider(13, range=0..15)
number_slider_3 = Slider(100, range=0..100)
xy = XYPlane(Origin=Point(0, 0, 0))
panel = BilayerPanel(
    BasePlane=xy,
    BoardWidth=number_slider_3,
    BoardLength=number_slider,
    WidthCount=number_slider_2,
    LengthCount=Slider(4, range=0..10))

species = WoodSpecies()
item = ListItem(List=species, Index=0, Wrap=True)  # -> Item, Item1

# ---- group: spruce
data = Data(item.Item1)

# ---- group: beech
data_2 = Data(item.Item)

# ----
board_count = Slider(100, range=0..100)

deconstruct_panel = DeconstructPanel(Panel=panel)
dec_board = DeconstructBoard(Board=deconstruct_panel)  # -> Name, Material, Polyline, Radius, MoistureChange, Error, BlendedRadius, Width
area = Area(Geometry=dec_board.Polyline)  # -> Area, Centroid

pt = Point(area.Centroid)
pdecon = Deconstruct(Point=pt)  # -> XComponent, YComponent, ZComponent
number_slider_4 = Slider(0, range=0..1)
bnd = Bounds(Numbers=flatten(pdecon.XComponent))

# ---- group: calculate weights
pt_2 = Point(area.Centroid)
avr = Average(Input=flatten(pt_2))
pdecon_2 = Deconstruct(Point=pt_2)  # -> XComponent, YComponent, ZComponent
pdecon_3 = Deconstruct(Point=avr)  # -> XComponent, YComponent, ZComponent
subtraction = Subtraction(A=pdecon_2.XComponent, B=pdecon_3.XComponent)
abs = Absolute(Value=subtraction)
bnd_2 = Bounds(Numbers=flatten(abs))
dom = ConstructDomain(DomainStart=Slider(1, range=0..1000), DomainEnd=Slider(1, range=0..10))
remap = RemapNumbers(Value=abs, Source=bnd_2, Target=dom)  # -> Mapped, Clipped

# ---- group: material goals / beech
data_3 = Data(data_2)

# ---- group: material goals / spruce
data_4 = Data(data)

# ---- group: material goals
pt_3 = Point(area.Centroid)
pdecon_4 = Deconstruct(Point=pt_3)  # -> XComponent, YComponent, ZComponent
avr_2 = Average(Input=flatten(pdecon_4.XComponent))
smaller = SmallerThan(FirstNumber=pdecon_4.XComponent, SecondNumber=avr_2)  # -> SmallerThan, OrEqualTo
lng = ListLength(List=flatten(smaller.SmallerThan))
lng_2 = ListLength(List=smaller.SmallerThan)  # -> flatten(Length)
dup = DuplicateData(Data=data_4, Number=lng, Order=True)
dup_2 = DuplicateData(Data=data_3, Number=lng, Order=True)
partition = PartitionList(List=dup, Size=lng_2)  # -> simplify(Chunks)
partition_2 = PartitionList(List=dup_2, Size=lng_2)  # -> simplify(Chunks)
not = GateNot(A=smaller.SmallerThan)
cull = CullPattern(List=partition, CullPattern=not)
cull_2 = CullPattern(List=partition_2, CullPattern=smaller.SmallerThan)
merge = Merge(Data1=cull_2, Data2=cull)

# ----
dedomain = DeconstructDomain(Domain=bnd)  # -> Start, End

# ---- group: name
num = Number(board_count)
series = Series(Start=0, Step=1, Count=num)
dup_3 = DuplicateData(Data="S", Number=num, Order=True)  # -> graft(Data)
txt = Text(graft(series))
merge_2 = Merge(Data1=dup_3, Data2=txt)  # -> simplify(Result)
join = TextJoin(Text=merge_2)  # -> flatten(Result)

# ----
twn2nums = TweenTwoNumbers(NumberA=dedomain.Start, NumberB=dedomain.End, Factor=number_slider_4)
pdecon_5 = Deconstruct(Point=pt)  # -> XComponent, YComponent, ZComponent

# ---- group: RT
dom_2 = ConstructDomain(DomainStart=Slider(11, range=0..100), DomainEnd=Slider(75, range=0..100))
random = Random(Range=dom_2, Number=board_count, Seed=Slider(225, range=0..1000))

dom_3 = ConstructDomain(DomainStart=Slider(15, range=0..100), DomainEnd=Slider(75, range=0..100))
random_2 = Random(Range=dom_3, Number=board_count, Seed=Slider(225, range=0..1000))

# ---- group: name
num_2 = Number(board_count)
series_2 = Series(Start=0, Step=1, Count=num_2)
dup_4 = DuplicateData(Data="B", Number=num_2, Order=True)  # -> graft(Data)
txt_2 = Text(graft(series_2))
merge_3 = Merge(Data1=dup_4, Data2=txt_2)  # -> simplify(Result)
join_2 = TextJoin(Text=merge_3)  # -> flatten(Result)

# ----
subtraction_2 = Subtraction(A=twn2nums, B=pdecon_5.XComponent)
abs_2 = Absolute(Value=subtraction_2)

# ---- group: desired radius
pt_4 = Point(area.Centroid)
pdecon_6 = Deconstruct(Point=pt_4)  # -> XComponent, YComponent, ZComponent
bnd_3 = Bounds(Numbers=flatten(pdecon_6.XComponent))
dom_4 = ConstructDomain(DomainStart=Slider(250, range=0..1000), DomainEnd=Slider(1800, range=0..10000))
remap_2 = RemapNumbers(Value=abs_2, Source=bnd_3, Target=dom_4)  # -> Mapped, Clipped

# ---- group: length
num_3 = Number(number_slider)
num_4 = Number(board_count)
dup_5 = DuplicateData(Data=num_3, Number=num_4, Order=True)

num_5 = Number(number_slider_3)
num_6 = Number(board_count)
dup_6 = DuplicateData(Data=num_5, Number=num_6, Order=True)

num_7 = Number(number_slider_3)
num_8 = Number(board_count)
dup_7 = DuplicateData(Data=num_7, Number=num_8, Order=True)

num_9 = Number(number_slider)
num_10 = Number(board_count)
dup_8 = DuplicateData(Data=num_9, Number=num_10, Order=True)

# ----
panel_2 = Panel(remap_2.Mapped)
series_3 = Series(Start=Slider(1, range=0..1), Step=1, Count=Slider(25, range=0..100))

# ---- group: moisture changes
panel_3 = Panel("""5
10
15""")
num_11 = Number(series_3)

# ----
stockpile = Stockpile(Material=data_2, Name=join_2, Length=dup_5, Width=dup_6, RTAngle=random, MoistureChanges=num_11)
stockpile_2 = Stockpile(Material=data, Name=join, Length=dup_8, Width=dup_7, RTAngle=random_2, MoistureChanges=num_11)
update_panel = UpdatePanel(Panel=panel, Radius=remap_2.Mapped, RadiusWeight=remap.Mapped, Material=merge, MaterialWeight=remap.Mapped)
merge_4 = Merge(Data1=stockpile, Data2=stockpile_2)

# ---- group: the brains
design_env = DesignEnvironment(Panels=update_panel, Stockpile=merge_4)  # -> Panels, Stockpiles
deconstruct_panel_2 = DeconstructPanel(Panel=design_env.Panels)
dec_board_2 = DeconstructBoard(Board=deconstruct_panel_2)  # -> Name, Material, Polyline, Radius, MoistureChange, Error, BlendedRadius, Width
bnd_4 = Bounds(Numbers=flatten(dec_board_2.Radius))
bnd_5 = Bounds(Numbers=flatten(dec_board_2.Error))
dedomain_2 = DeconstructDomain(Domain=bnd_4)  # -> Start, End
error = Panel(bnd_5)
multiplication = Multiplication(A=dedomain_2.End, B=Slider(1.1, range=0..10))
convolution = CurvatureConvolution(
    Panel=design_env.Panels,
    TengentialBlending=Slider(0.5, range=0.0001..2),
    LongitudinalBlending=Slider(0.25, range=0.0001..2),
    MaxRadiusInfluence=multiplication)
crosecset = UniqueCrossSections(Panel=convolution)
dec_board_3 = DeconstructBoard(Board=crosecset)  # -> Name, Material, Polyline, Radius, MoistureChange, Error, BlendedRadius, Width

# ----
panel_4 = Panel(dec_board_2.Error)

crv = Curve(dec_board_3.Polyline)
area_2 = Area(Geometry=crv)  # -> Area, Centroid
avr_3 = Average(Input=area_2.Centroid)
bbox = BoundingBox(Content=flatten(crv), Plane=PlaneXY(0, 0, 0), UnionBox=True)  # -> Box, Box_2
bbox_2 = BoundingBox(Content=flatten(avr_3), Plane=PlaneXY(0, 0, 0), UnionBox=True)  # -> Box, Box_2
debox = DeconstructBox(Box=bbox.Box)  # -> Plane, X, Y, Z
debox_2 = DeconstructBox(Box=bbox_2.Box)  # -> Plane, X, Y, Z
dedomain_3 = DeconstructDomain(Domain=debox.X)  # -> Start, End
dedomain_4 = DeconstructDomain(Domain=debox_2.X)  # -> Start, End
subtraction_3 = Subtraction(A=dedomain_3.End, B=dedomain_3.Start)
subtraction_4 = Subtraction(A=dedomain_4.End, B=dedomain_4.Start)
area_3 = Area(Geometry=bbox.Box)  # -> Area, Centroid
division = Division(A=subtraction_3, B=subtraction_4)
scale = Scale(Geometry=avr_3, Center=area_3.Centroid, Factor=division)  # -> Geometry, Transform
yz = YZPlane(Origin=scale.Geometry)

num_12 = Number(dec_board_3.BlendedRadius)
num_13 = Number(dec_board_3.Width)
pln = Plane(yz)
c_script = CSharpScript(iRadii=num_12, iBoardWidth=num_13, iPlanes=pln)  # -> out, simplify(A); inputs iRadii: tree of Double, iBoardWidth: tree of Double, iPlanes: tree of Plane
# ---------- c_script: C# ----------
    DataTree<Point3d> pointTree = new DataTree<Point3d>();

    for (int j = 0; j < iRadii.BranchCount; j++)
    {

      //initialize variables
      Plane bp = iPlanes.Branch(j)[0];
      Point3d startPoint = new Point3d(bp.Origin);
      Point3d centerPoint = startPoint;
      Vector3d rotationAxis = new Vector3d(bp.ZAxis);
      Vector3d centerPointVect = new Vector3d(bp.YAxis);
      centerPointVect.Rotate(Math.PI / 2, rotationAxis);

      for (int i = 0; i < iRadii.Branch(j).Count; i++){
        GH_Path pth = new GH_Path(j, i);
        Point3d point1 = startPoint;
        Point3d point2 = startPoint;

        pointTree.Add(point1, pth);

        //calculate rotation angle
        Double arcLength = iBoardWidth.Branch(j)[i];
        Double radius = iRadii.Branch(j)[i];
        Double rotation = (arcLength / radius);

        //calculate rotation center point
        centerPointVect.Unitize();
        centerPointVect *= radius;
        centerPoint += centerPointVect;


        //execute half rotation
        Transform tx = Transform.Rotation(rotation / 2, rotationAxis, centerPoint);


        point2.Transform(tx);
        pointTree.Add(point2, pth);

        //execute full rotation
        tx = Transform.Rotation(rotation, rotationAxis, centerPoint);
        startPoint.Transform(tx);
        pointTree.Add(startPoint, pth);

        //updata rotation parameters
        centerPoint = startPoint;
        centerPointVect.Transform(tx);
      }
    }
    A = pointTree;
# ---------- end c_script ----------

trim = TrimTree(Tree=c_script.A, Depth=1)
cullpt = CullDuplicates(Points=trim, Tolerance=0.1, CullMode=3)  # -> Points, Indices, Valence
pt_5 = Point(cullpt.Points)

# ---- group: animate
pt_6 = Point(simplify(pt_5))
pln_2 = Plane(graft(pln))
num_14 = Number(Slider(1, range=0..1))
c_script_2 = CSharpScript(iPoints=simplify(pt_6), iPlanes=pln_2, iShapeFactor=num_14)  # -> out, A; inputs iPoints: tree of Point3d, iPlanes: tree of Plane, iShapeFactor: Double
# ---------- c_script_2: C# ----------
    DataTree<Point3d> output = new DataTree<Point3d>();
    
    double shapeFactor = 1.0 - iShapeFactor;

    //step through curves
    for (int i = 0; i < iPoints.BranchCount; i++)
    {
      Plane currentPlane = iPlanes.Branch(iPoints.Path(i)[0])[0];

      //get vectors from plane
      Vector3d zVect = currentPlane.YAxis;

      Vector3d rotVect = currentPlane.ZAxis;

      //create new startpoint inside list
      Point3d startPoint = iPoints.Branch(i)[0];

      //step through points. Create and rotate vectors
      for (int j = 0; j < iPoints.Branch(i).Count; j++)
      {
        if (j == 0) output.Add(startPoint, iPoints.Path(i));
        else{
          //create current segment vector
          Vector3d segmentVect = new Vector3d(iPoints.Branch(i)[j] - iPoints.Branch(i)[j - 1]);

          //measure angle with vertical vector
          double angle = Vector3d.VectorAngle(zVect, segmentVect, currentPlane);

          //rotate
          segmentVect.Rotate(-angle * shapeFactor, rotVect);

          startPoint += segmentVect;
          output.Add(startPoint, iPoints.Path(i));
        }
      }
    }

    A = output;
# ---------- end c_script_2 ----------
pt_7 = Point(c_script_2.A)
intcrv = Interpolate(Vertices=pt_7, Degree=3, Periodic=False, KnotStyle=1)  # -> Curve, Length, Domain
crv_2 = Curve(intcrv.Curve)

# ----
crv_3 = Curve(crv_2)
pt_8 = Point(simplify(graft(scale.Geometry)))
end = EndPoints(Curve=crv_3)  # -> Start, End
vec2pt = Vector2Pt(PointA=end.Start, PointB=end.End, Unitize=False)  # -> Vector, Length
yz_2 = YZPlane(Origin=end.Start)
Y = UnitY(Factor=1)
angle = Angle(VectorA=vec2pt.Vector, VectorB=Y, Plane=yz_2)  # -> Angle, Reflex
rotate = Rotate(Geometry=crv_3, Angle=angle.Angle, Plane=yz_2)  # -> Geometry, Transform
curvepoint = PointOnCurve(rotate.Geometry, parameter=0.5)
vec2pt_2 = Vector2Pt(PointA=curvepoint, PointB=pt_8, Unitize=False)  # -> Vector, Length
move = Move(Geometry=rotate.Geometry, Motion=vec2pt_2.Vector)  # -> flatten(Geometry), Transform
crv_4 = Curve(reverse(move.Geometry))
loft = Loft(Curves=crv_4, Options={Adjust=False, Closed=False, LoftEnds=0, LoftSimp=0, LoftType=0, Rebuild=10, Refit=0.01})

number_slider_5 = Slider(15, range=0..100)
num_15 = Number(number_slider_2)
srf = Surface(loft)
quads = QuadPanels(Surface=graft(srf), UDivisions=number_slider_5, VDivisions=num_15)
srf_2 = Surface(reparameterize(quads))

smesh = SimpleMesh(Brep=srf_2)

area_4 = MeshArea(Mesh=smesh)  # -> Area, Centroid
meshcp = MeshClosestPoint(Point=area_4.Centroid, Mesh=smesh)  # -> Point, Index, Parameter
meval = MeshEval(Mesh=smesh, Parameter=meshcp.Parameter)  # -> Point, Normal, Colour
pl = PlaneNormal(Origin=meval.Point, ZAxis=meval.Normal)
X = UnitX(Factor=1)
deplane = DeconstructPlane(Plane=pl)  # -> Origin, XAxis, YAxis, ZAxis
angle_2 = Angle(VectorA=deplane.XAxis, VectorB=X, Plane=pl)  # -> Angle, Reflex
rotate_2 = Rotate(Geometry=pl, Angle=angle_2.Angle, Plane=pl)  # -> graft(Geometry), Transform

medges = MeshEdges(Mesh=smesh)  # -> simplify(NakedEdges), InteriorEdges, NonManifoldEdges
curvepoint_2 = PointOnCurve(medges.NakedEdges, parameter=0.5)
plcoord = PlaneCoordinates(Point=curvepoint_2, System=rotate_2.Geometry)  # -> XCoordinate, YCoordinate, ZCoordinate
sort = SortList(Keys=plcoord.XCoordinate, ValuesA=medges.NakedEdges)  # -> Keys, ValuesA
sort_2 = SortList(Keys=plcoord.YCoordinate, ValuesA=medges.NakedEdges)  # -> Keys, ValuesA
item_2 = ListItem(List=reverse(sort.ValuesA), Index=0, Wrap=True)
item_3 = ListItem(List=reverse(sort_2.ValuesA), Index=0, Wrap=True)
item_4 = ListItem(List=sort.ValuesA, Index=0, Wrap=True)
item_5 = ListItem(List=sort_2.ValuesA, Index=0, Wrap=True)

merge_5 = Merge(Data1=item_4, Data2=item_2)  # -> flatten(Result)
rdlines = RemoveDuplicateLinesKaramba3D(Line=merge_5, LimitDistance=0.005)  # -> OutLine, Info, Indexes
join_3 = JoinCurves(Curves=rdlines.OutLine, Preserve=False)
explode = Explode(Curve=join_3, Recursive=True)  # -> Segments, Vertices
pline = PolyLine(Vertices=explode.Vertices, Closed=False)  # -> simplify(flatten(Polyline))
curvepoint_3 = PointOnCurve(pline, parameter=0.5)
pdecon_7 = Deconstruct(Point=curvepoint_3)  # -> XComponent, YComponent, ZComponent
sort_3 = SortList(Keys=pdecon_7.XComponent, ValuesA=pline)  # -> Keys, ValuesA
crv_5 = Curve(sort_3.ValuesA)

merge_6 = Merge(Data1=item_5, Data2=item_3)  # -> flatten(Result)
rdlines_2 = RemoveDuplicateLinesKaramba3D(Line=merge_6, LimitDistance=0.005)  # -> OutLine, Info, Indexes
join_4 = JoinCurves(Curves=rdlines_2.OutLine, Preserve=False)
explode_2 = Explode(Curve=join_4, Recursive=True)  # -> Segments, Vertices
pline_2 = PolyLine(Vertices=explode_2.Vertices, Closed=False)  # -> simplify(flatten(Polyline))
curvepoint_4 = PointOnCurve(pline_2, parameter=0.5)
pdecon_8 = Deconstruct(Point=curvepoint_4)  # -> XComponent, YComponent, ZComponent
sort_4 = SortList(Keys=pdecon_8.YComponent, ValuesA=pline_2)  # -> Keys, ValuesA
crv_6 = Curve(sort_4.ValuesA)

crv_7 = Curve(crv_5)
item_6 = ListItem(List=crv_7, Index=0, Wrap=True)
curvepoint_5 = PointOnCurve(crv_7, parameter=0.5)
curvepoint_6 = PointOnCurve(item_6, parameter=0.5)
vec2pt_3 = Vector2Pt(PointA=curvepoint_6, PointB=curvepoint_5, Unitize=False)  # -> Vector, Length
move_2 = Move(Geometry=item_6, Motion=vec2pt_3.Vector)  # -> Geometry, Transform

crv_8 = Curve(crv_5)
flip = FlipCurve(Curve=crv_8, Guide=move_2.Geometry)  # -> Curve, Flag

explode_3 = Explode(Curve=flip.Curve, Recursive=True)  # -> simplify(Segments), Vertices
explode_4 = Explode(Curve=move_2.Geometry, Recursive=True)  # -> simplify(Segments), Vertices
lng_3 = ListLength(List=explode_3.Segments)
lng_4 = ListLength(List=explode_3.Segments)
lng_5 = ListLength(List=explode_4.Segments)
lng_6 = ListLength(List=explode_4.Segments)
subtraction_5 = Subtraction(A=lng_3, B=2)
subtraction_6 = Subtraction(A=lng_4, B=1)
subtraction_7 = Subtraction(A=lng_5, B=2)
subtraction_8 = Subtraction(A=lng_6, B=1)
dom_5 = ConstructDomain(DomainStart=0, DomainEnd=subtraction_5)
dom_6 = ConstructDomain(DomainStart=1, DomainEnd=subtraction_6)
dom_7 = ConstructDomain(DomainStart=0, DomainEnd=subtraction_7)
dom_8 = ConstructDomain(DomainStart=1, DomainEnd=subtraction_8)
subset = SubList(List=explode_3.Segments, Domain=dom_5, Wrap=True)  # -> List, Index
subset_2 = SubList(List=explode_3.Segments, Domain=dom_6, Wrap=True)  # -> List, Index
subset_3 = SubList(List=explode_4.Segments, Domain=dom_7, Wrap=True)  # -> List, Index
subset_4 = SubList(List=explode_4.Segments, Domain=dom_8, Wrap=True)  # -> List, Index
angle_3 = Angle(VectorA=subset_3.List, VectorB=subset_4.List)  # -> simplify(Angle), Reflex
angle_4 = Angle(VectorA=subset.List, VectorB=subset_2.List)  # -> simplify(Angle), Reflex
num_16 = Number(angle_3.Angle)
num_17 = Number(angle_4.Angle)

explode_5 = Explode(Curve=flip.Curve, Recursive=True)  # -> simplify(Segments), Vertices
explode_6 = Explode(Curve=move_2.Geometry, Recursive=True)  # -> simplify(Segments), Vertices
flip_2 = FlipMatrix(Data=explode_5.Segments)
flip_3 = FlipMatrix(Data=explode_6.Segments)
crv_9 = Curve(flip_3)
crv_10 = Curve(flip_2)
lng_7 = ListLength(List=crv_10)  # -> expr("x-2", Length)
lng_8 = ListLength(List=crv_9)  # -> expr("x-2", Length)
lng_9 = ListLength(List=crv_10)  # -> expr("x-1", Length)
lng_10 = ListLength(List=crv_9)  # -> expr("x-1", Length)
dom_9 = ConstructDomain(DomainStart=0, DomainEnd=lng_7)
dom_10 = ConstructDomain(DomainStart=0, DomainEnd=lng_8)
dom_11 = ConstructDomain(DomainStart=1, DomainEnd=lng_9)
dom_12 = ConstructDomain(DomainStart=1, DomainEnd=lng_10)
subset_5 = SubList(List=crv_10, Domain=dom_9, Wrap=True)  # -> graft(List), Index
subset_6 = SubList(List=crv_9, Domain=dom_10, Wrap=True)  # -> graft(List), Index
subset_7 = SubList(List=crv_10, Domain=dom_11, Wrap=True)  # -> graft(List), Index
subset_8 = SubList(List=crv_9, Domain=dom_12, Wrap=True)  # -> graft(List), Index
loft_2 = Loft(
    Curves=[subset_5.List, subset_7.List],
    Options={Adjust=False, Closed=False, LoftEnds=0, LoftSimp=0, LoftType=0, Rebuild=10, Refit=0.01})  # -> simplify(Loft)
loft_3 = Loft(
    Curves=[subset_6.List, subset_8.List],
    Options={Adjust=False, Closed=False, LoftEnds=0, LoftSimp=0, LoftType=0, Rebuild=10, Refit=0.01})  # -> simplify(Loft)
smesh_2 = SimpleMesh(Brep=loft_2)
smesh_3 = SimpleMesh(Brep=loft_3)
mjoin = MeshJoin(Meshes=flatten(smesh_3))
mjoin_2 = MeshJoin(Meshes=flatten(smesh_2))
weld = WeldMesh(Mesh=mjoin, Angle=3.141592654)
weld_2 = WeldMesh(Mesh=mjoin_2, Angle=3.141592654)

explode_7 = Explode(Curve=move_2.Geometry, Recursive=True)  # -> Segments, Vertices
num_18 = Number(num_17)
num_19 = Number(num_16)
mesh = Mesh(weld)
number_slider_6 = Slider(10, range=0..100000)
flip_4 = FlipMatrix(Data=explode_7.Vertices)
division_2 = Division(A=num_18, B=num_19)
avr_4 = Average(Input=division_2)  # -> flatten(ArithmeticMean)
pline_3 = PolyLine(Vertices=flip_4, Closed=False)  # -> simplify(flatten(Polyline))
crv_11 = Curve(move_2.Geometry)
rod = Rod(
    Polyline=pline_3,
    LengthFactor=1,
    AngleFactor=1,
    AxialStrength=number_slider_6,
    BendStrength=Slider(10000, range=0..10000))  # -> flatten(R)
rod_2 = Rod(
    Polyline=crv_11,
    LengthFactor=1,
    AngleFactor=avr_4,
    AxialStrength=number_slider_6,
    BendStrength=Slider(10000, range=0..10000))  # -> flatten(R)
show = Show(G=mesh)
merge_7 = Merge(Data1=rod, Data2=rod_2, Data3=show)

deconstruct_panel_3 = DeconstructPanel(Panel=convolution)
dec_board_4 = DeconstructBoard(Board=deconstruct_panel_3)  # -> Name, Material, Polyline, Radius, MoistureChange, Error, BlendedRadius, Width
movopossum_3_0_0 = Opossum(
    OpossumData_OptimizationType=1,
    OpossumData_ResultSerializationStatus=0,
    OpossumData_objective=num_22,
    OpossumData_variable=number_slider_4)

zombiesolver = ZombieSolver(GoalObjects=merge_7, Threshold=1e-10, Tolerance=0.0001, MaxIterations=Slider(10000, range=0..100000))  # -> I, V, O
mesh_2 = Mesh(zombiesolver.O)
clean = CleanTree(RemoveNulls=True, RemoveInvalid=True, RemoveEmpty=False, Tree=mesh_2)

mesh_3 = Mesh(clean)

mesh_4 = Mesh(mesh_3)
num_20 = Number(expr("x+1", number_slider_5))
medges_2 = MeshEdges(Mesh=mesh_4)  # -> NakedEdges, InteriorEdges, NonManifoldEdges
demesh = DeconstructMesh(Mesh=mesh_4)  # -> Vertices, Faces, Colours, Normals
join_5 = JoinCurves(Curves=medges_2.NakedEdges, Preserve=False)
patch = Patch(Curves=join_5, Points=demesh.Vertices, Spans=num_20, Flexibility=Slider(1, range=0..1), Trim=True)
srf_3 = Surface(patch)

merge_8 = Merge(Data1=flatten(clean), Data2=flatten(weld_2))
wbedges = WeaverbirdsMeshEdges(MeshOrPolylines=graft(merge_8))
bang = ExplodeTree(Data=wbedges)  # -> Branch0, Branch1
len = Length(Curve=bang.Branch1)
len_2 = Length(Curve=bang.Branch0)
subtraction_9 = Subtraction(A=len, B=len_2)
smaller_2 = SmallerThan(FirstNumber=subtraction_9, SecondNumber=0)  # -> SmallerThan, OrEqualTo
dispatch = Dispatch(List=subtraction_9, DispatchPattern=smaller_2.SmallerThan)  # -> ListA, ListB
bnd_6 = Bounds(Numbers=dispatch.ListA)
bnd_7 = Bounds(Numbers=dispatch.ListB)
dedomain_5 = DeconstructDomain(Domain=bnd_6)  # -> Start, End
dedomain_6 = DeconstructDomain(Domain=bnd_7)  # -> Start, End
Y_2 = UnitY(Factor=Slider(2000, range=0..5000))
move_3 = Move(Geometry=bang.Branch0, Motion=Y_2)  # -> Geometry, Transform
gradient = Gradient(
    LowerLimit=dedomain_5.Start,
    UpperLimit=dedomain_5.End,
    Parameter=dispatch.ListA,
    stops=[0: RGB(234, 38, 0), 0.499: RGB(234, 126, 0), 1: RGB(254, 244, 84), 1: RGB(75, 107, 169), 1: RGB(173, 203, 249)])
dispatch_2 = Dispatch(List=move_3.Geometry, DispatchPattern=smaller_2.SmallerThan)  # -> ListA, ListB
gradient_2 = Gradient(
    LowerLimit=dedomain_6.Start,
    UpperLimit=dedomain_6.End,
    Parameter=dispatch.ListB,
    stops=[0: RGB(254, 244, 84), 0.501: RGB(173, 203, 249), 1: RGB(75, 107, 169)])
previewlw = CustomPreviewLineweights(Geometry=dispatch_2.ListA, Shader=gradient, Thickness=3, Absolute=False)
previewlw_2 = CustomPreviewLineweights(Geometry=dispatch_2.ListB, Shader=gradient_2, Thickness=3, Absolute=False)

crv_12 = Curve(bang.Branch0)
end_2 = EndPoints(Curve=crv_12)  # -> Start, End
pdecon_9 = Deconstruct(Point=end_2.Start)  # -> XComponent, YComponent, ZComponent
pdecon_10 = Deconstruct(Point=end_2.End)  # -> XComponent, YComponent, ZComponent
subtraction_10 = Subtraction(A=pdecon_9.XComponent, B=pdecon_10.XComponent)
abs_3 = Absolute(Value=subtraction_10)
smaller_3 = SmallerThan(FirstNumber=abs_3, SecondNumber=Slider(100, range=0..100))  # -> SmallerThan, OrEqualTo
cull_3 = CullPattern(List=crv_12, CullPattern=smaller_3.SmallerThan)
join_6 = JoinCurves(Curves=cull_3, Preserve=False)
curvepoint_7 = PointOnCurve(join_6, parameter=0.5)
pdecon_11 = Deconstruct(Point=curvepoint_7)  # -> XComponent, YComponent, ZComponent
sort_5 = SortList(Keys=pdecon_11.XComponent, ValuesA=join_6)  # -> Keys, ValuesA
explode_8 = Explode(Curve=sort_5.ValuesA, Recursive=True)  # -> Segments, Vertices
intcrv_2 = Interpolate(Vertices=explode_8.Vertices, Degree=3, Periodic=False, KnotStyle=1)  # -> flatten(Curve), Length, Domain
loft_4 = Loft(Curves=intcrv_2.Curve, Options={Adjust=False, Closed=False, LoftEnds=0, LoftSimp=0, LoftType=0, Rebuild=10, Refit=0.01})

mesh_5 = Mesh(mesh_3)
c_script_3 = CSharpScript(mesh=mesh_5, surface=srf_3)  # -> out, Curvature; inputs mesh: Mesh, surface: Surface
# ---------- c_script_3: C# ----------
        //get surface gaussian curvature at each mesh point
        List<double> gaussianCurvatures = new List<double>();
        double maxGaussian = 0;
        double minGaussian = double.MaxValue;

        double U;
        double V;

        for (int i = 0; i < mesh.Vertices.Count; i++)
        {
            Point3d currentMeshPoint = mesh.Vertices.Point3dAt(i);
            surface.ClosestPoint(currentMeshPoint, out U, out V);
            SurfaceCurvature surfaceCurvature = surface.CurvatureAt(U, V);
            double gaussian = surfaceCurvature.Gaussian;
            gaussianCurvatures.Add(gaussian);

            //get the range of curvatures
            if (gaussian > maxGaussian) maxGaussian = gaussian;
            if( gaussian < minGaussian) minGaussian = gaussian;
        }


        //get the range of curvatures


        //remap the curvatures to color values on the mesh points
        for (int i = 0; i < mesh.Vertices.Count; i++)
        {
            double hue = (gaussianCurvatures[i] - minGaussian) / (0 - minGaussian) * (0.5 - maxGaussian) + maxGaussian;
        }
        Curvature = gaussianCurvatures;
# ---------- end c_script_3 ----------
num_21 = Number(c_script_3.Curvature)
bnd_8 = Bounds(Numbers=num_21)
dedomain_7 = DeconstructDomain(Domain=bnd_8)  # -> Start, End
gradient_3 = Gradient(
    LowerLimit=dedomain_7.Start,
    UpperLimit=dedomain_7.End,
    Parameter=num_21,
    stops=[0: RGB(0, 128, 0), 0.5: RGB(255, 255, 0), 1: RGB(255, 0, 0)])
mesh_6 = Mesh(mesh_5)
c_script_4 = CSharpScript(mesh=mesh_6, colors=gradient_3)  # -> out, A; inputs mesh: Mesh, colors: list of Color
# ---------- c_script_4: C# ----------
    for(int i = 0; i < mesh.Vertices.Count; i++)
    {
      mesh.VertexColors.SetColor(i, colors[i]);
    }
    A = mesh;
# ---------- end c_script_4 ----------

gaussian_curvature = Panel(bnd_8)
relaxation = Panel(bnd_6)

curvepoint_8 = PointOnCurve(intcrv_2.Curve, parameter=0.5)
pdecon_12 = Deconstruct(Point=curvepoint_8)  # -> XComponent, YComponent, ZComponent
bnd_9 = Bounds(Numbers=pdecon_12.ZComponent)

srf_4 = Surface(reparameterize(loft_4))  # disabled
crv_13 = Curve(dec_board_4.Polyline)  # disabled
explode_9 = Explode(Curve=crv_13, Recursive=True)  # -> Segments, Vertices; disabled
number_slider_7 = Slider(50, range=0..100)  # disabled
len_3 = Length(Curve=explode_9.Segments)  # disabled
runion = RegionUnion(Curves=flatten(crv_13))  # disabled
division_3 = Division(A=len_3, B=number_slider_7)  # disabled
srf_5 = Surface(reparameterize(runion))  # disabled
divide = DivideCurve(Curve=explode_9.Segments, Count=division_3, Kinks=False)  # -> Points, Tangents, Parameters; disabled
srf_cp = SurfaceClosestPoint(Point=divide.Points, Surface=srf_5)  # -> Point, UVPoint, Distance; disabled
evalsrf = EvaluateSurface(Surface=reparameterize(srf_4), Point=srf_cp.UVPoint)  # -> Point, Normal, UDirection, VDirection, Frame; disabled
intcrv_3 = Interpolate(Vertices=evalsrf.Point, Degree=3, Periodic=False, KnotStyle=1)  # -> Curve, Length, Domain; disabled
trim_2 = TrimTree(Tree=intcrv_3.Curve, Depth=1)  # disabled
join_7 = JoinCurves(Curves=trim_2, Preserve=False)  # -> simplify(Curves); disabled
trim_3 = TrimTree(Tree=join_7, Depth=1)  # -> graft(Tree); disabled
c_script_5 = CSharpScript(surface=srf_4, curves=trim_3)  # -> out, A; inputs surface: Brep, curves: tree of Curve; disabled
# ---------- c_script_5: C# ----------
    DataTree<Brep> splitBreps = new DataTree<Brep>();
    for(int i = 0; i < curves.BranchCount; i++)
    {
      Brep[] results = surface.Split(curves.Branch(i), 0.01);
      foreach(Brep brep in results)
      {
        splitBreps.Add(brep, curves.Paths[i]);
      }
    }
    A = splitBreps;
# ---------- end c_script_5 ----------
area_5 = Area(Geometry=c_script_5.A)  # -> Area, Centroid; disabled
sort_6 = SortList(Keys=area_5.Area, ValuesA=c_script_5.A)  # -> Keys, ValuesA; disabled
item_7 = ListItem(List=sort_6.ValuesA, Index=0, Wrap=True)  # disabled
trim_4 = TrimTree(Tree=item_7, Depth=1)  # disabled
srf_6 = Surface(trim_4)  # disabled

dedomain_8 = DeconstructDomain(Domain=bnd_9)  # -> Start, End
num_22 = Number(dedomain_8.End)
panel_5 = Panel(num_22)

srf_7 = Surface(srf_6)  # disabled
txt_3 = Text(dec_board_4.Material)  # disabled
len_4 = TextLength(Text=txt_3)  # disabled
bnd_10 = Bounds(Numbers=len_4)  # disabled
dedomain_9 = DeconstructDomain(Domain=bnd_10)  # -> Start, End; disabled
gradient_4 = Gradient(
    LowerLimit=dedomain_9.Start,
    UpperLimit=dedomain_9.End,
    Parameter=len_4,
    stops=[0: RGB(186, 186, 186), 1: RGB(122, 122, 122)])  # disabled
panel_6 = Panel(txt_3)  # disabled
preview = CustomPreview(Geometry=srf_7, Material=gradient_4)  # disabled

mesh_7 = Mesh(clean)
mesh_8 = Mesh(weld_2)
merge_9 = Merge(Data1=mesh_7, Data2=mesh_8)
wbfacepolys = WeaverbirdsFacePolylines(Mesh=merge_9)  # -> simplify(Polygons)
explode_10 = Explode(Curve=wbfacepolys, Recursive=True)  # -> Segments, Vertices
cullpt_2 = CullDuplicates(Points=explode_10.Vertices, Tolerance=0.1, CullMode=3)  # -> simplify(Points), Indices, Valence
avr_5 = Average(Input=cullpt_2.Points)
trim_5 = TrimTree(Tree=avr_5, Depth=1)
bang_2 = ExplodeTree(Data=trim_5)  # -> Branch0, Branch1
dist = Distance(PointA=bang_2.Branch0, PointB=bang_2.Branch1)

bang_3 = ExplodeTree(Data=wbfacepolys)  # -> Branch0, Branch1

pline2msh = PolylineToMesh(Polyline=bang_3.Branch0, Quadrangulate=True)  # -> flatten(Mesh)

bnd_11 = Bounds(Numbers=dist)
dedomain_10 = DeconstructDomain(Domain=bnd_11)  # -> Start, End
gradient_5 = Gradient(
    LowerLimit=dedomain_10.Start,
    UpperLimit=dedomain_10.End,
    Parameter=dist,
    stops=[0: RGB(75, 107, 169), 0.254: RGB(173, 203, 249), 0.5: RGB(254, 244, 84), 0.754: RGB(234, 126, 0), 1: RGB(234, 38, 0)])
mesh_9 = Mesh(pline2msh)
preview_2 = CustomPreview(Geometry=mesh_9, Material=gradient_5)

bbox_3 = BoundingBox(Content=mesh_9, Plane=PlaneXY(0, 0, 0), UnionBox=True)  # -> Box, Box_2
debrep = DeconstructBrep(Brep=bbox_3.Box)  # -> Faces, Edges, Vertices
number_slider_8 = Slider(1000, range=0..1000)
item_8 = ListItem(List=debrep.Edges, Index=0, Wrap=True)  # -> Item, Item1
ext = ExtendCurve(Curve=item_8.Item1, Type=0, Start=number_slider_8, End=number_slider_8)
